# Requirement set AVD012_Requirements (R2025b)
AVD-012 requirement flow-down: RFP requirements decompose into System-level requirements, which decompose into Subsystem-level (derived) requirements. Generated from the traceability matrix by build_avd012_requirements.m.

Attributes:
- Source: Origin category of the requirement (RFP or Derived).
- SourceDetail: Specific citation: RFP paragraph, or parent requirement(s)/standard the item derives from.
- VerificationMethod: Analysis / Test / Inspection / Demonstration (comma-separated if more than one applies).

## 1 [#1] RFP Requirements (Container)

### 1.1 [RFP-3.1.b.b] General Design – Propulsion
Minimize propulsion development cost and schedule risk by using proven engine technology.
Source: RFP
SourceDetail: RFP 3.1.b.b
VerificationMethod: Inspection

### 1.2 [RFP-3.1.c.a] General Design – Materials
Airframe must survive a decade of carrier/maritime operations without excessive maintenance.
Source: RFP
SourceDetail: RFP 3.1.c.a
VerificationMethod: Analysis, Test

### 1.3 [RFP-3.1.c.b] General Design – Materials
Avoid schedule/cost risk from immature or scarce materials.
Source: RFP
SourceDetail: RFP 3.1.c.b
VerificationMethod: Inspection

### 1.4 [RFP-3.1.d.a] General Design – Subsystems
Avoid integrating immature technology that could delay IOC.
Source: RFP
SourceDetail: RFP 3.1.d.a
VerificationMethod: Analysis, Inspection

### 1.5 [RFP-3.2] Risk Tolerance
The carrier and its crew must not be put at greater risk by adding this aircraft to the air wing. Even if the air vehicle can be lost, the carrier itself cannot be endangered by that loss.
Source: RFP
SourceDetail: RFP 3.2
VerificationMethod: Analysis

### 1.6 [RFP-3.3.a] Carrier Suitability
Operate from the carriers the Navy actually has and will have.
Source: RFP
SourceDetail: RFP 3.3.a
VerificationMethod: Analysis, Demonstration

### 1.7 [RFP-3.3.b] Carrier Suitability
Fit efficiently on a crowded flight/hangar deck alongside crewed aircraft.
Source: RFP
SourceDetail: RFP 3.3.b
VerificationMethod: Analysis

### 1.8 [RFP-3.3.c.b] Carrier Suitability
Communicate reliably with existing carrier deck-handling and ground-control infrastructure.
Source: RFP
SourceDetail: RFP 3.3.c.b
VerificationMethod: Analysis, Inspection

### 1.9 [RFP-3.3.d] Carrier Suitability
Land safely and autonomously without relying on human piloting.
Source: RFP
SourceDetail: RFP 3.3.d
VerificationMethod: Test, Demonstration

### 1.10 [RFP-3.3.1.a] Carrier Suitability – Launch
Launch reliably even in adverse hot, calm-wind conditions.
Source: RFP
SourceDetail: RFP 3.3.1.a
VerificationMethod: Analysis

### 1.11 [RFP-3.3.1.b] Carrier Suitability – Launch
Leave the catapult safely under worst-case sink/control conditions.
Source: RFP
SourceDetail: RFP 3.3.1.b
VerificationMethod: Analysis

### 1.12 [RFP-3.3.2.a] Carrier Suitability – Recovery
Design the arresting hook/gear interface to a realistic engaging speed.
Source: RFP
SourceDetail: RFP 3.3.2.a
VerificationMethod: Analysis

### 1.13 [RFP-3.3.2.b] Carrier Suitability – Recovery
Approach at a controllable but not excessive speed.
Source: RFP
SourceDetail: RFP 3.3.2.b
VerificationMethod: Analysis

### 1.14 [RFP-3.3.2.c] Carrier Suitability – Recovery
Land with an operationally realistic fuel/store reserve.
Source: RFP
SourceDetail: RFP 3.3.2.c
VerificationMethod: Analysis

### 1.15 [RFP-3.4.1.a] Payload – Air-to-Air
Carry enough sensor/avionics capability to conduct the air-to-air mission.
Source: RFP
SourceDetail: RFP 3.4.1.a
VerificationMethod: Analysis, Inspection

### 1.16 [RFP-3.4.1.b.a] Payload – Air-to-Air
Be lethal in the counter-air fighter-sweep role.
Source: RFP
SourceDetail: RFP 3.4.1.b.a
VerificationMethod: Inspection, Demonstration

### 1.17 [RFP-3.4.2.a] Payload – Strike
Carry enough sensor/avionics capability to conduct the strike mission.
Source: RFP
SourceDetail: RFP 3.4.2.a
VerificationMethod: Analysis, Inspection

### 1.18 [RFP-3.4.2.b.a] Payload – Strike
Be lethal in the strike role.
Source: RFP
SourceDetail: RFP 3.4.2.b.a
VerificationMethod: Inspection, Demonstration

### 1.19 [RFP-3.5.1.a] Mission – Air-to-Air
Reach the fight and return, extending the air wing's reach.
Source: RFP
SourceDetail: RFP 3.5.1.a
VerificationMethod: Analysis

### 1.20 [RFP-3.5.1.b] Mission – Air-to-Air
Stay in the fight long enough to be tactically useful.
Source: RFP
SourceDetail: RFP 3.5.1.b
VerificationMethod: Analysis

### 1.21 [RFP-3.5.1.d] Mission – Air-to-Air
Close on or disengage from a target quickly when tactically necessary.
Source: RFP
SourceDetail: RFP 3.5.1.d
VerificationMethod: Analysis

### 1.22 [RFP-3.5.2.a] Mission – Strike
Reach strike targets and return.
Source: RFP
SourceDetail: RFP 3.5.2.a
VerificationMethod: Analysis

### 1.23 [RFP-3.5.2.b] Mission – Strike
Penetrate and egress contested airspace at low altitude.
Source: RFP
SourceDetail: RFP 3.5.2.b
VerificationMethod: Analysis

### 1.24 [RFP-3.5.2.c] Mission – Strike
Survive the low-altitude ingress/egress at adequate speed.
Source: RFP
SourceDetail: RFP 3.5.2.c
VerificationMethod: Analysis

### 1.25 [RFP-3.6.a] Point Performance
Withstand maneuvering loads expected in combat.
Source: RFP
SourceDetail: RFP 3.6.a
VerificationMethod: Analysis

### 1.26 [RFP-3.6.b] Point Performance
Carry a useful, flexible external stores loadout.
Source: RFP
SourceDetail: RFP 3.6.b
VerificationMethod: Analysis

### 1.27 [RFP-3.6.c] Point Performance
Launch using the catapults the fleet already has.
Source: RFP
SourceDetail: RFP 3.6.c
VerificationMethod: Analysis

### 1.28 [RFP-3.6.d] Point Performance
Recover using the arresting gear the fleet already has.
Source: RFP
SourceDetail: RFP 3.6.d
VerificationMethod: Analysis

### 1.29 [RFP-3.6.e] Point Performance
Survive an engine failure right after catapult launch, if multi-engine.
Source: RFP
SourceDetail: RFP 3.6.e
VerificationMethod: Analysis

### 1.30 [RFP-3.6.f] Point Performance
Survive an engine failure on approach, if multi-engine.
Source: RFP
SourceDetail: RFP 3.6.f
VerificationMethod: Analysis

### 1.31 [RFP-3.6.g] Point Performance
Fit within carrier elevator/hangar geometry when spread.
Source: RFP
SourceDetail: RFP 3.6.g
VerificationMethod: Inspection

### 1.32 [RFP-3.6.h] Point Performance
Fit within carrier elevator/hangar geometry when stowed.
Source: RFP
SourceDetail: RFP 3.6.h
VerificationMethod: Inspection

### 1.33 [RFP-3.6.i] Point Performance
Clear the jet blast deflector envelope like other embarked aircraft.
Source: RFP
SourceDetail: RFP 3.6.i
VerificationMethod: Inspection

### 1.34 [RFP-3.6.j] Point Performance
Fit inside the hangar bay.
Source: RFP
SourceDetail: RFP 3.6.j
VerificationMethod: Inspection

### 1.35 [RFP-3.6.k] Point Performance
Survive repeated arrested landings without hook failure.
Source: RFP
SourceDetail: RFP 3.6.k
VerificationMethod: Analysis, Test

### 1.36 [RFP-3.6.l] Point Performance
Stay within a size/weight class the Navy considers affordable and deck-compatible.
Source: RFP
SourceDetail: RFP 3.6.l
VerificationMethod: Analysis

### 1.37 [RFP-3.6.n] Point Performance
Be certifiable and flyable under Navy airworthiness authority.
Source: RFP
SourceDetail: RFP 3.6.n
VerificationMethod: Inspection, Analysis

## 2 [#2] System Requirements (Container)

### 2.1 [SYS-001] Engine production/qualification status
Engine(s) shall be an existing, currently-in-production design.
Source: RFP
SourceDetail: RFP 3.1.b.b
VerificationMethod: Inspection

### 2.2 [SYS-002] Structural material qualified service life in a maritime environment
≥10 years, with demonstrated resistance to moisture intrusion and salt spray.
Source: RFP
SourceDetail: RFP 3.1.c.a
VerificationMethod: Analysis, Test

### 2.3 [SYS-003] Material production availability
All primary structural/system materials currently available in production quantities.
Source: RFP
SourceDetail: RFP 3.1.c.b
VerificationMethod: Inspection

### 2.4 [SYS-004] Subsystem technology readiness level (TRL)
TRL ≥ 6 for all subsystems (incl. avionics, mission systems) at design freeze.
Source: RFP
SourceDetail: RFP 3.1.d.a
VerificationMethod: Analysis, Inspection

### 2.5 [SYS-005] Incremental risk to host carrier
No additional risk to the carrier beyond current air wing baseline.
Source: RFP
SourceDetail: RFP 3.2
VerificationMethod: Analysis

### 2.6 [SYS-006] System redundancy/reliability sufficient to bound carrier risk
Redundancy present such that assessed carrier risk is acceptable even given air-vehicle loss.
Source: RFP
SourceDetail: RFP 3.2
VerificationMethod: Analysis

### 2.7 [SYS-007] Carrier class compatibility
Operable from CVN-68 (Nimitz) and CVN-78 (Ford) class carriers.
Source: RFP
SourceDetail: RFP 3.3.a
VerificationMethod: Analysis, Demonstration

### 2.8 [SYS-008] Stowed (wings-folded) planform spot factor
≤ 0.8, where spot factor is measured relative to the F/A-18E/F Super Hornet reference planform per OPNAV 3710.7 carrier-suitability criteria.
Source: RFP
SourceDetail: RFP 3.3.b
VerificationMethod: Analysis

### 2.9 [SYS-009] Reserved SWAP-C for MD-5 GCS / deck-handling comms
Sufficient reserved size/weight/power/cooling margin to support MD-5 GCS and deck-handling system interfaces.
Source: RFP
SourceDetail: RFP 3.3.c.b
VerificationMethod: Analysis, Inspection

### 2.10 [SYS-010] Automatic landing guidance capability
2-way JPALS (differential GPS) automatic carrier landing.
Source: RFP
SourceDetail: RFP 3.3.d
VerificationMethod: Test, Demonstration

### 2.11 [SYS-011] Launch capability at max ambient temperature / zero WOD
Capable of catapult launch at 89.8°F with 0 kt Wind Over Deck.
Source: RFP
SourceDetail: RFP 3.3.1.a
VerificationMethod: Analysis

### 2.12 [SYS-012] Catapult minimum end airspeed
Highest of: (1) CG sink ≤10 ft w/ deck run ≤32 ft, (2) 90% CLmax power-off OGE, (3) if multi-engine, min single-engine control speed.
Source: RFP
SourceDetail: RFP 3.3.1.b
VerificationMethod: Analysis

### 2.13 [SYS-013] Arrestment engaging speed (relative to approach speed)
Not less than 1.05 times the approach airspeed defined in SYS-014.
Source: RFP
SourceDetail: RFP 3.3.2.a
VerificationMethod: Analysis

### 2.14 [SYS-014] Approach airspeed
>10% above stall speed, and ≤145 kt.
Source: RFP
SourceDetail: RFP 3.3.2.b
VerificationMethod: Analysis

### 2.15 [SYS-015] Arrestment design landing weight
Includes 10-min loiter fuel at 10,000 ft + 2 landing attempts + 25% max fuel weight + 50% store weight.
Source: RFP
SourceDetail: RFP 3.3.2.c
VerificationMethod: Analysis

### 2.16 [SYS-016] Internal avionics/sensor weight (A2A)
≤ 1,000 lb internal weight allocated for air-to-air mission avionics and sensors.
Source: RFP
SourceDetail: RFP 3.4.1.a
VerificationMethod: Analysis, Inspection

### 2.17 [SYS-017] Air-to-air ordnance load
2× AIM-120D.
Source: RFP
SourceDetail: RFP 3.4.1.b.a
VerificationMethod: Inspection, Demonstration

### 2.18 [SYS-018] Internal avionics/sensor weight (strike)
≤ 1,000 lb internal weight allocated for strike-mission avionics and sensors.
Source: RFP
SourceDetail: RFP 3.4.2.a
VerificationMethod: Analysis, Inspection

### 2.19 [SYS-019] Strike ordnance load
4× GBU-53/B Small Diameter Bomb II.
Source: RFP
SourceDetail: RFP 3.4.2.b.a
VerificationMethod: Inspection, Demonstration

### 2.20 [SYS-020] Combat radius (A2A mission)
≥500 nm. (700 nm desirable — tracked as a Measure of Merit.)
Source: RFP
SourceDetail: RFP 3.5.1.a
VerificationMethod: Analysis

### 2.21 [SYS-021] Max-thrust combat persistence at best-turn speed, 10,000 ft (A2A)
≥2 min. (5 min desirable — MoM.)
Source: RFP
SourceDetail: RFP 3.5.1.b
VerificationMethod: Analysis

### 2.22 [SYS-022] Dash speed at 30,000 ft (A2A)
≥ Mach 0.8. (Mach 0.95 desirable — MoM.)
Source: RFP
SourceDetail: RFP 3.5.1.d
VerificationMethod: Analysis

### 2.23 [SYS-023] Combat radius (strike mission)
≥500 nm. (700 nm desirable — MoM.)
Source: RFP
SourceDetail: RFP 3.5.2.a
VerificationMethod: Analysis

### 2.24 [SYS-024] Sea-level ingress/egress dash distance & thrust setting (strike)
50 nm at intermediate (max non-afterburning) thrust.
Source: RFP
SourceDetail: RFP 3.5.2.b
VerificationMethod: Analysis

### 2.25 [SYS-025] Sea-level dash speed (strike)
≥ Mach 0.8. (Mach 0.90 desirable — MoM.)
Source: RFP
SourceDetail: RFP 3.5.2.c
VerificationMethod: Analysis

### 2.26 [SYS-026] Design vertical load factor (Nz) at mid-mission weight
≥ 5g.
Source: RFP
SourceDetail: RFP 3.6.a
VerificationMethod: Analysis

### 2.27 [SYS-027] External store carriage capacity
≥1,000 lb total; ≥400 lb per single station.
Source: RFP
SourceDetail: RFP 3.6.b
VerificationMethod: Analysis

### 2.28 [SYS-028] Launch performance vs. WOD, using C-13-2 catapult
Achievable with WOD ≤ 0 kt.
Source: RFP
SourceDetail: RFP 3.6.c
VerificationMethod: Analysis

### 2.29 [SYS-029] Recovery performance vs. WOD, using Mark 7 Mod 3 gear
Achievable with WOD ≤ 15 kt.
Source: RFP
SourceDetail: RFP 3.6.d
VerificationMethod: Analysis

### 2.30 [SYS-030] Single-engine rate of climb (SEROC) at launch
≥200 ft/min.
Source: RFP
SourceDetail: RFP 3.6.e
VerificationMethod: Analysis

### 2.31 [SYS-031] Single-engine rate of climb (SEROC) on approach
≥500 ft/min.
Source: RFP
SourceDetail: RFP 3.6.f
VerificationMethod: Analysis

### 2.32 [SYS-032] Unfolded wingspan
≤60 ft.
Source: RFP
SourceDetail: RFP 3.6.g
VerificationMethod: Inspection

### 2.33 [SYS-033] Folded wingspan
≤ 35 ft, measured wings-folded per NAVAIR carrier elevator/hangar clearance criteria.
Source: RFP
SourceDetail: RFP 3.6.h
VerificationMethod: Inspection

### 2.34 [SYS-034] Overall aircraft length
≤ F-35C overall length.
Source: RFP
SourceDetail: RFP 3.6.i
VerificationMethod: Inspection

### 2.35 [SYS-035] Overall height, wings folded
≤18.5 ft.
Source: RFP
SourceDetail: RFP 3.6.j
VerificationMethod: Inspection

### 2.36 [SYS-036] Arresting hook design strength
≥200,000 lbf.
Source: RFP
SourceDetail: RFP 3.6.k
VerificationMethod: Analysis, Test

### 2.37 [SYS-037] Maximum takeoff gross weight
≤60,000 lb.
Source: RFP
SourceDetail: RFP 3.6.l
VerificationMethod: Analysis

### 2.38 [SYS-038] Airworthiness certification compliance
Meets NAVAIR airworthiness requirements (NAVAIRINST 13034.1 flight clearance; MIL-HDBK-516D criteria).
Source: RFP
SourceDetail: RFP 3.6.n
VerificationMethod: Inspection, Analysis

## 3 [#3] Subsystem Requirements (Container)

### 3.1 [SUB-001] Engine qualification/type-certificate status
Candidate engines limited to those with an existing DoD or commercial type certificate/qualification.
Rationale: Minimize propulsion development cost and schedule risk (refines SYS-001).
Source: Derived
SourceDetail: Derived from SYS-001; JSSG-2007D
VerificationMethod: Inspection

### 3.2 [SUB-002] Structural material corrosion/marine qualification
MIL-HDBK-5/MMPDS-qualified alloys (e.g., 7075-T7351 aluminum, Ti-6Al-4V titanium) with documented salt-spray corrosion resistance per ASTM B117.
Rationale: Survive a decade of maritime exposure without excessive maintenance (refines SYS-002/003).
Source: Derived
SourceDetail: Derived from SYS-002, SYS-003
VerificationMethod: Analysis, Inspection

### 3.3 [SUB-003] Line-replaceable unit (LRU) TRL qualification record
Sourced exclusively from vendors with a documented TRL ≥ 6 per DoD TRL definitions (existing production or flight-qualified line-replaceable units).
Rationale: Avoid immature avionics technology (refines SYS-004).
Source: Derived
SourceDetail: Derived from SYS-004
VerificationMethod: Inspection

### 3.4 [SUB-004] Control-surface actuation & command-link redundancy level
≥ 1 level of redundancy in primary flight-control actuation.
Rationale: Bound carrier risk through actuation redundancy (refines SYS-005/006).
Source: Derived
SourceDetail: Derived from SYS-005, SYS-006
VerificationMethod: Analysis

### 3.5 [SUB-005] Lost-link / fail-safe autonomy behavior
Automatic return-to-marshal or safe-ditch behavior requiring no deck intervention.
Rationale: Bound carrier risk if the air vehicle is lost (refines SYS-005/006).
Source: Derived
SourceDetail: Derived from SYS-005, SYS-006; DoDD 3000.09
VerificationMethod: Analysis, Demonstration

### 3.6 [SUB-006] Outer mold line / wing-fold geometry
Unfolded span ≤60 ft, folded span ≤35 ft, length ≤ F-35C length, folded height ≤18.5 ft — simultaneously.
Rationale: Fit carrier elevator/hangar geometry (refines SYS-007, SYS-032–035).
Source: Derived
SourceDetail: Derived from SYS-007, SYS-032, SYS-033, SYS-034, SYS-035
VerificationMethod: Analysis, Inspection

### 3.7 [SUB-007] Stowed planform area relative to benchmark
Stowed planform area ≤ 0.8 times the F/A-18E/F Super Hornet reference spot factor (consistent with SYS-008).
Rationale: Fit efficiently on a crowded deck (refines SYS-008).
Source: Derived
SourceDetail: Derived from SYS-008
VerificationMethod: Analysis

### 3.8 [SUB-008] Avionics data-bus bandwidth/interface reservation
MIL-STD-1553C bus with reserved I/O for MD-5 GCS & deck-handling interfaces. Caveat: may need a supplemental high-bandwidth bus for sensor/autonomy data.
Rationale: Communicate with MD-5 GCS / deck systems (refines SYS-009).
Source: Derived
SourceDetail: Derived from SYS-009; MIL-STD-1553C
VerificationMethod: Analysis, Inspection

### 3.9 [SUB-009] Navigation subsystem JPALS/datalink integration
Integrated JPALS-compatible DGPS receiver + 2-way datalink.
Rationale: Land automatically via JPALS (refines SYS-010).
Source: Derived
SourceDetail: Derived from SYS-010
VerificationMethod: Test, Demonstration

### 3.10 [SUB-010] Wing/high-lift sizing vs. catapult end-speed condition
Meets the governing catapult end-speed case (highest of the SYS-012 CG-sink, CLmax, and single-engine-control criteria) at max design takeoff weight, 89.8°F Day, 0 kt WOD.
Rationale: Leave the catapult safely (refines SYS-011/012).
Source: Derived
SourceDetail: Derived from SYS-011, SYS-012
VerificationMethod: Analysis

### 3.11 [SUB-011] Landing gear & hook design condition
Designed to arrestment landing weight at engaging speed = 1.05–1.15× stall, ≤145 kt approach.
Rationale: Land within an operationally realistic weight/speed envelope (refines SYS-013–015).
Source: Derived
SourceDetail: Derived from SYS-013, SYS-014, SYS-015
VerificationMethod: Analysis

### 3.12 [SUB-012] Mission-systems bay weight/volume allocation
1,000 lb weight allocation plus adequate volume, common to both missions.
Rationale: Carry mission avionics for both mission profiles (refines SYS-016/018).
Source: Derived
SourceDetail: Derived from SYS-016, SYS-018
VerificationMethod: Analysis, Inspection

### 3.13 [SUB-013] Weapons bay/station capacity & compatibility
Internal/external accommodation of 2×AIM-120D or 4×GBU-53/B; external stations ≥400 lb, ≥1,000 lb total. Confirm internal-vs-external split with team.
Rationale: Carry lethal payload for both missions (refines SYS-017/019/027).
Source: Derived
SourceDetail: Derived from SYS-017, SYS-019, SYS-027
VerificationMethod: Inspection, Demonstration

### 3.14 [SUB-014] Usable fuel fraction vs. combat radius
Sufficient fuel for a 500 nm combat radius, both missions. High-priority carpet-plot driver.
Rationale: Reach combat radius on both missions (refines SYS-020/023).
Source: Derived
SourceDetail: Derived from SYS-020, SYS-023
VerificationMethod: Analysis

### 3.15 [SUB-015] Sustained thrust duration capability
Sustains max (A2A) / intermediate (strike) thrust for the required combat-persistence durations without exceeding thermal/fuel-flow limits.
Rationale: Sustain combat persistence on both missions (refines SYS-021/024).
Source: Derived
SourceDetail: Derived from SYS-021, SYS-024
VerificationMethod: Analysis

### 3.16 [SUB-016] Airframe/propulsion dash-speed capability
Sustains Mach 0.8 at 30,000 ft without exceeding structural/thermal limits.
Rationale: Achieve dash speed at altitude (refines SYS-022).
Source: Derived
SourceDetail: Derived from SYS-022
VerificationMethod: Analysis

### 3.17 [SUB-017] Primary structure (wing/fuselage/hook fitting) design condition
5g limit load at mid-mission weight; hook fitting reacts ≥200,000 lbf; within a 60,000 lb MTOW budget. High-priority structural driver.
Rationale: Withstand design loads and hook loads within the weight budget (refines SYS-026/036/037).
Source: Derived
SourceDetail: Derived from SYS-026, SYS-036, SYS-037
VerificationMethod: Analysis, Test

### 3.18 [SUB-018] Launch performance vs. published C-13-2 chart
Verified against the C-13-2 catapult performance chart (RFP Fig. 2) at design launch weight.
Rationale: Launch on fielded carrier equipment (refines SYS-028).
Source: Derived
SourceDetail: Derived from SYS-028
VerificationMethod: Analysis

### 3.19 [SUB-019] One-engine-inoperative climb performance
200 ft/min (launch) and 500 ft/min (approach), one-engine-inoperative.
Rationale: Survive an engine-out condition, if multi-engine (refines SYS-030/031).
Source: Derived
SourceDetail: Derived from SYS-030, SYS-031
VerificationMethod: Analysis

### 3.20 [SUB-020] Design/verification process compliance
Follows NAVAIRINST 13034.1 flight-clearance review and MIL-HDBK-516D airworthiness criteria.
Rationale: Be certifiable under Navy airworthiness authority (refines SYS-038).
Source: Derived
SourceDetail: Derived from SYS-038; NAVAIRINST 13034.1; MIL-HDBK-516D
VerificationMethod: Inspection